# Grasshopper definition Parametric Modeling Program.gh (Grasshopper 1.0.7)
# Copyright: 云湾科技
# plug-ins: Wallacei, Excel

起始 = Slider(22, range=0..30)

X = Slider(3, range=0..100)
Y = Slider(11, range=0..100)

geometry_pipeline = GeometryPipeline(
    GroupByLayer=False,
    GroupByType=False,
    IncludeHidden=True,
    IncludeLocked=True,
    LayerFilter="地块::地块00",
    NameFilter="*",
    SublayerFiltering=True,
    TypeFilter=4)
geometry_pipeline_2 = GeometryPipeline(
    GroupByLayer=False,
    GroupByType=False,
    IncludeHidden=True,
    IncludeLocked=True,
    LayerFilter="地块::地块01",
    NameFilter="*",
    SublayerFiltering=True,
    TypeFilter=4)
geometry_pipeline_3 = GeometryPipeline(
    GroupByLayer=False,
    GroupByType=False,
    IncludeHidden=True,
    IncludeLocked=True,
    LayerFilter="地块::地块02",
    NameFilter="*",
    SublayerFiltering=True,
    TypeFilter=4)
geometry_pipeline_4 = GeometryPipeline(
    GroupByLayer=False,
    GroupByType=False,
    IncludeHidden=True,
    IncludeLocked=True,
    LayerFilter="地块::地块03",
    NameFilter="*",
    SublayerFiltering=True,
    TypeFilter=4)
geometry_pipeline_5 = GeometryPipeline(
    GroupByLayer=False,
    GroupByType=False,
    IncludeHidden=True,
    IncludeLocked=True,
    LayerFilter="地块::地块04",
    NameFilter="*",
    SublayerFiltering=True,
    TypeFilter=4)
geometry_pipeline_6 = GeometryPipeline(
    GroupByLayer=False,
    GroupByType=False,
    IncludeHidden=True,
    IncludeLocked=True,
    LayerFilter="地块::地块05",
    NameFilter="*",
    SublayerFiltering=True,
    TypeFilter=4)
geometry_pipeline_7 = GeometryPipeline(
    GroupByLayer=False,
    GroupByType=False,
    IncludeHidden=True,
    IncludeLocked=True,
    LayerFilter="地块::地块06",
    NameFilter="*",
    SublayerFiltering=True,
    TypeFilter=4)
geometry_pipeline_8 = GeometryPipeline(
    GroupByLayer=False,
    GroupByType=False,
    IncludeHidden=True,
    IncludeLocked=True,
    LayerFilter="地块::地块07",
    NameFilter="*",
    SublayerFiltering=True,
    TypeFilter=4)
geometry_pipeline_9 = GeometryPipeline(
    GroupByLayer=False,
    GroupByType=False,
    IncludeHidden=True,
    IncludeLocked=True,
    LayerFilter="地块::地块08",
    NameFilter="*",
    SublayerFiltering=True,
    TypeFilter=4)
geometry_pipeline_10 = GeometryPipeline(
    GroupByLayer=False,
    GroupByType=False,
    IncludeHidden=True,
    IncludeLocked=True,
    LayerFilter="地块::地块09",
    NameFilter="*",
    SublayerFiltering=True,
    TypeFilter=4)
geometry_pipeline_11 = GeometryPipeline(
    GroupByLayer=False,
    GroupByType=False,
    IncludeHidden=True,
    IncludeLocked=True,
    LayerFilter="地块::地块10",
    NameFilter="*",
    SublayerFiltering=True,
    TypeFilter=4)
geometry_pipeline_12 = GeometryPipeline(
    GroupByLayer=False,
    GroupByType=False,
    IncludeHidden=True,
    IncludeLocked=True,
    LayerFilter="地块::地块11",
    NameFilter="*",
    SublayerFiltering=True,
    TypeFilter=4)
间距 = Slider(1, range=0..30)
construct_point = ConstructPoint(XCoordinate=0, YCoordinate=0, ZCoordinate=0)
square = Square(Plane=construct_point, Size=起始, ExtentX=X, ExtentY=X)  # -> Cells, simplify(Points)
curve = Curve(geometry_pipeline)
curve_2 = Curve(geometry_pipeline_2)
curve_3 = Curve(geometry_pipeline_3)
curve_4 = Curve(geometry_pipeline_4)
curve_5 = Curve(geometry_pipeline_5)
curve_6 = Curve(geometry_pipeline_6)
curve_7 = Curve(geometry_pipeline_9)
curve_8 = Curve(geometry_pipeline_10)
curve_9 = Curve(geometry_pipeline_7)
curve_10 = Curve(geometry_pipeline_8)
curve_11 = Curve(geometry_pipeline_11)
curve_12 = Curve(geometry_pipeline_12)
negative = Negative(Value=间距)
offset_curve = OffsetCurve(Curve=square.Cells, Distance=negative, Corners=1)  # -> simplify(Curve)
discontinuity = Discontinuity(Curve=curve, Level=1)  # -> simplify(Points), Parameters
discontinuity_2 = Discontinuity(Curve=curve_2, Level=1)  # -> simplify(Points), Parameters
discontinuity_3 = Discontinuity(Curve=curve_3, Level=1)  # -> simplify(Points), Parameters
discontinuity_4 = Discontinuity(Curve=curve_4, Level=1)  # -> simplify(Points), Parameters
discontinuity_5 = Discontinuity(Curve=curve_5, Level=1)  # -> simplify(Points), Parameters
discontinuity_6 = Discontinuity(Curve=curve_6, Level=1)  # -> simplify(Points), Parameters
discontinuity_7 = Discontinuity(Curve=curve_9, Level=1)  # -> simplify(Points), Parameters
discontinuity_8 = Discontinuity(Curve=curve_10, Level=1)  # -> simplify(Points), Parameters
discontinuity_9 = Discontinuity(Curve=curve_7, Level=1)  # -> simplify(Points), Parameters
discontinuity_10 = Discontinuity(Curve=curve_8, Level=1)  # -> simplify(Points), Parameters
discontinuity_11 = Discontinuity(Curve=curve_11, Level=1)  # -> simplify(Points), Parameters
discontinuity_12 = Discontinuity(Curve=curve_12, Level=1)  # -> simplify(Points), Parameters
region_union = RegionUnion(Curves=flatten(square.Cells))
discontinuity_13 = Discontinuity(Curve=offset_curve, Level=1)  # -> simplify(Points), Parameters
average = Average(Input=discontinuity.Points)
average_2 = Average(Input=discontinuity_2.Points)
average_3 = Average(Input=discontinuity_3.Points)
average_4 = Average(Input=discontinuity_4.Points)  # -> flatten(ArithmeticMean)
average_5 = Average(Input=discontinuity_5.Points)  # -> flatten(ArithmeticMean)
average_6 = Average(Input=discontinuity_6.Points)  # -> flatten(ArithmeticMean)
average_7 = Average(Input=discontinuity_7.Points)  # -> flatten(ArithmeticMean)
average_8 = Average(Input=discontinuity_8.Points)  # -> flatten(ArithmeticMean)
average_9 = Average(Input=discontinuity_9.Points)  # -> flatten(ArithmeticMean)
average_10 = Average(Input=discontinuity_10.Points)  # -> flatten(ArithmeticMean)
average_11 = Average(Input=discontinuity_11.Points)  # -> flatten(ArithmeticMean)
average_12 = Average(Input=discontinuity_12.Points)  # -> flatten(ArithmeticMean)
boundary_surfaces = BoundarySurfaces(Edges=region_union)
average_13 = Average(Input=discontinuity_13.Points)  # -> flatten(ArithmeticMean)

Z = Slider(0.1, range=0..0.1)
unit_z = UnitZ(Factor=Z)
negative_2 = Negative(Value=unit_z)
# Z轴±拉伸
move = Move(Geometry=boundary_surfaces, Motion=negative_2)  # -> Geometry, Transform
extrude = Extrude(Base=move.Geometry, Direction=negative_2)

list_item = ListItem(List=average_13, Index=0, Wrap=True)  # -> Item, Item1, Item2, Item3, Item4, Item5, Item6, Item7, Item8
geometry_pipeline_13 = GeometryPipeline(
    GroupByLayer=False,
    GroupByType=False,
    IncludeHidden=True,
    IncludeLocked=True,
    LayerFilter="地块::地块00",
    NameFilter="*",
    SublayerFiltering=True,
    TypeFilter=1073741848)
geometry_pipeline_14 = GeometryPipeline(
    GroupByLayer=False,
    GroupByType=False,
    IncludeHidden=True,
    IncludeLocked=True,
    LayerFilter="地块::地块01",
    NameFilter="*",
    SublayerFiltering=True,
    TypeFilter=1073741848)
geometry_pipeline_15 = GeometryPipeline(
    GroupByLayer=False,
    GroupByType=False,
    IncludeHidden=True,
    IncludeLocked=True,
    LayerFilter="地块::地块02",
    NameFilter="*",
    SublayerFiltering=True,
    TypeFilter=1073741848)
geometry_pipeline_16 = GeometryPipeline(
    GroupByLayer=False,
    GroupByType=False,
    IncludeHidden=True,
    IncludeLocked=True,
    LayerFilter="地块::地块03",
    NameFilter="*",
    SublayerFiltering=True,
    TypeFilter=1073741848)
geometry_pipeline_17 = GeometryPipeline(
    GroupByLayer=False,
    GroupByType=False,
    IncludeHidden=True,
    IncludeLocked=True,
    LayerFilter="地块::地块04",
    NameFilter="*",
    SublayerFiltering=True,
    TypeFilter=1073741848)
geometry_pipeline_18 = GeometryPipeline(
    GroupByLayer=False,
    GroupByType=False,
    IncludeHidden=True,
    IncludeLocked=True,
    LayerFilter="地块::地块05",
    NameFilter="*",
    SublayerFiltering=True,
    TypeFilter=1073741848)
geometry_pipeline_19 = GeometryPipeline(
    GroupByLayer=False,
    GroupByType=False,
    IncludeHidden=True,
    IncludeLocked=True,
    LayerFilter="地块::地块06",
    NameFilter="*",
    SublayerFiltering=True,
    TypeFilter=1073741848)
geometry_pipeline_20 = GeometryPipeline(
    GroupByLayer=False,
    GroupByType=False,
    IncludeHidden=True,
    IncludeLocked=True,
    LayerFilter="地块::地块07",
    NameFilter="*",
    SublayerFiltering=True,
    TypeFilter=1073741848)
geometry_pipeline_21 = GeometryPipeline(
    GroupByLayer=False,
    GroupByType=False,
    IncludeHidden=True,
    IncludeLocked=True,
    LayerFilter="地块::地块08",
    NameFilter="*",
    SublayerFiltering=True,
    TypeFilter=1073741848)
geometry_pipeline_22 = GeometryPipeline(
    GroupByLayer=False,
    GroupByType=False,
    IncludeHidden=True,
    IncludeLocked=True,
    LayerFilter="地块::地块09",
    NameFilter="*",
    SublayerFiltering=True,
    TypeFilter=1073741848)
geometry_pipeline_23 = GeometryPipeline(
    GroupByLayer=False,
    GroupByType=False,
    IncludeHidden=True,
    IncludeLocked=True,
    LayerFilter="地块::地块10",
    NameFilter="*",
    SublayerFiltering=True,
    TypeFilter=1073741848)
geometry_pipeline_24 = GeometryPipeline(
    GroupByLayer=False,
    GroupByType=False,
    IncludeHidden=True,
    IncludeLocked=True,
    LayerFilter="地块::地块11",
    NameFilter="*",
    SublayerFiltering=True,
    TypeFilter=1073741848)
merge = Merge(
    Data1=list_item.Item,
    Data2=list_item.Item1,
    Data3=list_item.Item2,
    Data4=list_item.Item3,
    Data5=list_item.Item4,
    Data6=list_item.Item5,
    Data7=list_item.Item6,
    Data8=list_item.Item7,
    Data9=list_item.Item8)  # -> simplify(graft(Result))
geometry = Geometry(geometry_pipeline_13)
geometry_2 = Geometry(geometry_pipeline_14)
geometry_3 = Geometry(geometry_pipeline_15)
geometry_4 = Geometry(geometry_pipeline_16)
geometry_5 = Geometry(geometry_pipeline_17)
geometry_6 = Geometry(geometry_pipeline_18)
geometry_7 = Geometry(geometry_pipeline_19)
geometry_8 = Geometry(geometry_pipeline_20)
geometry_9 = Geometry(geometry_pipeline_21)
geometry_10 = Geometry(geometry_pipeline_22)
geometry_11 = Geometry(geometry_pipeline_23)
geometry_12 = Geometry(geometry_pipeline_24)
gene_pool = GenePool(Decimals=0, Maximum=11, Minimum=0, Value=[9, 3, 0, 4, 11, 9, 8, 10, 9])
group = Group(Objects=geometry)
group_2 = Group(Objects=geometry_2)
group_3 = Group(Objects=geometry_3)
group_4 = Group(Objects=geometry_4)
group_5 = Group(Objects=geometry_5)
group_6 = Group(Objects=geometry_6)
group_7 = Group(Objects=geometry_7)
group_8 = Group(Objects=geometry_8)
group_9 = Group(Objects=geometry_9)
group_10 = Group(Objects=geometry_10)
group_11 = Group(Objects=geometry_11)
group_12 = Group(Objects=geometry_12)
pick_n_choose = PickNChoose(
    Pattern=simplify(graft(gene_pool)),
    Stream0=group,
    Stream1=group_2,
    Stream2=group_3,
    Stream3=group_4,
    Stream4=group_5,
    Stream5=group_6,
    Stream6=group_7,
    Stream7=group_8,
    Stream8=group_9,
    Stream9=group_10,
    Stream10=group_11,
    Stream11=group_12)
pick_n_choose_2 = PickNChoose(
    Pattern=simplify(graft(gene_pool)),
    Stream0=average,
    Stream1=average_2,
    Stream2=average_3,
    Stream3=average_4,
    Stream4=average_5,
    Stream5=average_6,
    Stream6=average_7,
    Stream7=average_8,
    Stream8=average_9,
    Stream9=average_10,
    Stream10=average_11,
    Stream11=average_12)  # -> simplify(Result)
数量 = Slider(3, range=1..10)  # disabled
series = Series(Start=0, Step=1, Count=数量)  # disabled
orient = Orient(Geometry=pick_n_choose, Source=pick_n_choose_2, Target=merge)  # -> Geometry, Transform
list_item_2 = ListItem(List=series, Index=0, Wrap=True)  # disabled
gene_pool_2 = GenePool(Decimals=0, Maximum=4, Minimum=0, Value=[4, 1, 2, 4, 1, 2, 0, 3, 1])
multiplication = Multiplication(A=gene_pool_2, Π2=1.570796327)  # -> simplify(graft(Result))
rotate = Rotate(Geometry=simplify(orient.Geometry), Angle=simplify(multiplication), Plane=simplify(merge))  # -> Geometry, Transform
stream_filter = StreamFilter(Gate=graft(0))  # disabled
分析物 = Geometry(extrude)
epw = FilePath("C:\Users\Administrator\Desktop\遗传\北京气候数据文件.epw")
ungroup = Ungroup(Group=rotate.Geometry)
pick_n_choose_3 = PickNChoose(Pattern=[0, 1])  # disabled
importepw = LBImportEPW(epw_file=epw)  # -> location, dry_bulb_temperature, dew_point_temperature, relative_humidity, wind_speed, wind_direction, direct_normal_rad, diffuse_horizontal_rad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; plug-in component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

# ---- group: 体->网格（设置）
对齐接缝顶点 = BooleanToggle(True)
平面最简化 = BooleanToggle(False)
精细网格 = BooleanToggle(True)
起始四角网格min数目 = Slider(1, range=1..100)
起始四角网格max数目 = Slider(200, range=1..800)
起始四角网格max长宽比 = Slider(16, range=1..100)
max边缘距离 = Slider(0, range=0..100)
max角度 = Slider(20, range=0..100)
min边缘长度 = Slider(1, range=0..100)
分析物brep = Brep(分析物)
max边缘长度 = Slider(15000, range=0..15000)
settings_custom = SettingsCustom(
    StitchSeams=对齐接缝顶点,
    SimplePlanes=平面最简化,
    Refine=精细网格,
    MinCount=起始四角网格min数目,
    MaxCount=起始四角网格max数目,
    AspectRatio=起始四角网格max长宽比,
    MaxDistance=max边缘距离,
    MaxAngle=max角度,
    MinEdge=min边缘长度,
    MaxEdge=min边缘长度)
mesh_brep = MeshBrep(Brep=分析物brep, Settings=settings_custom)

# ----
mesh = Mesh(分析物)
area = Area(Geometry=mesh)  # -> Area, Centroid; disabled
bounding_box = BoundingBox(Content=mesh, Plane=PlaneXY(0, 0, 0), UnionBox=True)  # -> Box, Box_2
n = Slider(4, range=0..5)
deconstruct_brep = DeconstructBrep(Brep=bounding_box.Box)  # -> Faces, Edges, Vertices
list_item_3 = ListItem(List=deconstruct_brep.Faces, Index=n, Wrap=True)
polygon_center = PolygonCenter(Polyline=list_item_3)  # -> CenterV, CenterE, CenterA

透明度 = Slider(0, range=0..1)  # disabled
光泽度 = Slider(80, range=0..100)  # disabled

# ----
# 铝合金配色
漫反射颜色 = ColourSwatch(SwatchColor=RGB(0, 0, 46))  # disabled
反射主颜色 = ColourSwatch(SwatchColor=RGB(255, 255, 255))  # disabled
自发光颜色 = ColourSwatch(SwatchColor=RGB(0, 0, 0))  # disabled
create_material = CreateMaterial(Diffuse=漫反射颜色, Specular=反射主颜色, Emission=自发光颜色, Transparency=透明度, Shine=光泽度)  # disabled
custom_preview = CustomPreview(Geometry=extrude, Material=create_material)  # disabled

dimensions = Dimensions(Surface=list_item_3)  # -> UDimension, VDimension
analysisperiod = LBAnalysisPeriod(start_month="12", start_day="22", start_hour="0", end_month="12", end_day="22", end_hour="23", timestep="1")  # -> period, hoys, dates; plug-in component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
point = Point(polygon_center.CenterV)
sunpath = LBSunPath(location=importepw.location, hoys=analysisperiod.hoys, center_pt=point, scale=Slider(0.6, range=0..100))  # -> out, vectors, altitudes, azimuths, hoys, sun_pts, analemma, daily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; plug-in component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
run = BooleanToggle(True)
日照物geo = Geometry(mesh_brep)
遮挡物geo = Geometry(ungroup)
directsunhours = LBDirectSunHours(
    vectors=flatten(sunpath.vectors),
    geometry=flatten(日照物geo),
    context=flatten(遮挡物geo),
    grid_size=dimensions.VDimension,
    offset_dist="0.1",
    run=run)  # -> out, points, results, mesh, legend, title, int_mtx; plug-in component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
mass_addition = MassAddition(Input=flatten(directsunhours.results))  # -> Result, PartialResults; disabled
average_14 = Average(Input=directsunhours.results)

L = Slider(0, range=0..250)
results = Data(directsunhours.results)
mesh_2 = Mesh(directsunhours.mesh)
colour = ColourSwatch(SwatchColor=RGB(0, 0, 0))
larger_than = LargerThan(FirstNumber=results, SecondNumber=L)  # -> LargerThan, OrEqualTo
gate_not = GateNot(A=larger_than.LargerThan)
cull_faces = CullFaces(Mesh=mesh_2, Pattern=larger_than.LargerThan)
cull_pattern = CullPattern(List=results, CullPattern=larger_than.LargerThan)
cull_faces_2 = CullFaces(Mesh=mesh_2, Pattern=gate_not)
mesh_colours = MeshColours(Mesh=cull_faces, Colours=colour)
heatmap = LBSpatialHeatmap(values=cull_pattern, mesh=cull_faces_2, legend_title="日照时长(h)", global_title="日照充裕区域")  # -> mesh, legend, title, colors, legend_par, vis_set; plug-in component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

# ----
# 1.在电池上点击鼠标右键
# 2.在弹出菜单中点 Select one  existing file
# 3.在弹出的窗口中选择***.stat文件
# 4.点击Enter确定，程序重新自动运行
ladybug = Ladybug_Ladybug()  # -> Vviiiiiiiiiizzz; plug-in component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
stat = FilePath("C:\Users\Administrator\Desktop\遗传\北京建筑群落气候影响统计.stat")

# ---- group: 计算次数与监测面设置
监测点高度 = Slider(1.5, range=0..10)
gentestpts = Honeybee_GenerateTestPoints(testGeometry=boundary_surfaces, gridSize=Slider(30, range=0..100), distBaseSrf=监测点高度, moveTestMesh=True)  # -> out, simplify(flatten(testPoints)), simplify(ptsVectors), simplify(facesArea), simplify(flatten(mesh)); plug-in component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

# ----
importepw_2 = Ladybug_ImportEpw(epwFile=epw)  # -> readMe, latitude, location, dryBulbTemperature, dewPointTemperature, relativeHumidity, windSpeed, windDirection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; plug-in component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
importstat = Ladybug_ImportStat(statFile=stat)  # -> readMe, ashraeClimateZone, koppenClimateZone, heatingDesignTemps, coolingDesignTemps, heatingDesignDay, coolingDesignDay, monthlyTauBeam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; plug-in component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
importstat_2 = Ladybug_ImportStat(statFile=stat)  # -> readMe, ashraeClimateZone, koppenClimateZone, heatingDesignTemps, coolingDesignTemps, heatingDesignDay, coolingDesignDay, monthlyTauBeam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; plug-in component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
importstat_3 = LBImportSTAT(stat_file=stat)  # -> location, ashrae_zone, koppen_zone, clear_dir_norm_rad, clear_diff_horiz_rad, ann_heat_dday_996, ann_heat_dday_990, ann_cool_dday_004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; disabled; plug-in component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
genpts = LBGeneratePointGrid()  # -> points, vectors, face_areas, mesh; disabled; plug-in component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

# ----
# 此处必须用原始电池
# 否则报错
# 温度里面不包含有效温度值
importepw_3 = LBImportEPW(epw_file=epw)  # -> location, dry_bulb_temperature, dew_point_temperature, relative_humidity, wind_speed, wind_direction, direct_normal_rad, diffuse_horizontal_rad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; disabled; plug-in component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

brep = Brep(flatten(ungroup))
brep_2 = Brep(flatten(ungroup))
buildings = Geometry(brep)
point_2 = Point(gentestpts.testPoints)
buildings_2 = Geometry(brep_2)
point_3 = Point(gentestpts.testPoints)

solaradjusttemperature = Ladybug_OutdoorSolarTemperatureAdjustor(
    location=[importepw_3.location, importepw_2.location],
    cumSkyMtxOrDirNormRad=[importepw_3.direct_normal_rad, importepw_2.directNormalRadiation],
    diffuseHorizRad=[importepw_3.diffuse_horizontal_rad, importepw_2.diffuseHorizontalRadiation],
    baseTemperature=[importepw_3.dry_bulb_temperature, importepw_2.dryBulbTemperature],
    horizInfraredRad=[importepw_3.horizontal_infrared_rad, importepw_2.horizontalInfraredRadiation],
    bodyPosture="3",
    bodyLocation=point_3,
    contextShading=buildings_2,
    analysisPeriodOrHOY=importstat.extremeHotWeek,
    runIt=Toggle(True))  # -> readMe, port, effectiveRadiantField, MRTDelta, solarAdjustedMRT, port_2, mannequinMesh, port_3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; plug-in component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
strnum = Ladybug_SeparateData(inputList=flatten(solaradjusttemperature.solarAdjustedMRT))  # -> numbers, strings; plug-in component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

selectandaveragedata = Ladybug_AverageData(annualHourlyData=importepw_2.dryBulbTemperature, analysisPeriod=importstat_2.typicalWinterWeek)  # -> readMe, selHourlyData, averagedDaily, averagedMonthly, avrMonthlyPerHour, avrMonthlyMinPerHour, avrMonthlyMaxPerHour; plug-in component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
selectandaveragedata_2 = Ladybug_AverageData(annualHourlyData=importepw_2.windSpeed, analysisPeriod=importstat_2.typicalWinterWeek)  # -> readMe, selHourlyData, averagedDaily, averagedMonthly, avrMonthlyPerHour, avrMonthlyMinPerHour, avrMonthlyMaxPerHour; plug-in component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
strnum_2 = Ladybug_SeparateData(inputList=flatten(selectandaveragedata_2.selHourlyData))  # -> numbers, strings; plug-in component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
strnum_3 = Ladybug_SeparateData(inputList=flatten(selectandaveragedata.selHourlyData))  # -> numbers, strings; plug-in component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

selectandaveragedata_3 = Ladybug_AverageData(annualHourlyData=importepw_2.relativeHumidity, analysisPeriod=importstat_2.typicalWinterWeek)  # -> readMe, selHourlyData, averagedDaily, averagedMonthly, avrMonthlyPerHour, avrMonthlyMinPerHour, avrMonthlyMaxPerHour; plug-in component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
strnum_4 = Ladybug_SeparateData(inputList=flatten(selectandaveragedata_3.selHourlyData))  # -> numbers, strings; plug-in component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

solaradjusttemperature_2 = Ladybug_OutdoorSolarTemperatureAdjustor(
    location=[importepw_3.location, importepw_2.location],
    cumSkyMtxOrDirNormRad=[importepw_3.direct_normal_rad, importepw_2.directNormalRadiation],
    diffuseHorizRad=[importepw_3.diffuse_horizontal_rad, importepw_2.diffuseHorizontalRadiation],
    baseTemperature=[importepw_3.dry_bulb_temperature, importepw_2.dryBulbTemperature],
    horizInfraredRad=[importepw_3.horizontal_infrared_rad, importepw_2.horizontalInfraredRadiation],
    bodyPosture="3",
    bodyLocation=point_2,
    contextShading=buildings,
    analysisPeriodOrHOY=importstat_2.typicalWinterWeek,
    runIt=Toggle(True))  # -> readMe, port, effectiveRadiantField, MRTDelta, solarAdjustedMRT, port_2, mannequinMesh, port_3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; plug-in component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
strnum_5 = Ladybug_SeparateData(inputList=flatten(solaradjusttemperature_2.solarAdjustedMRT))  # -> numbers, strings; plug-in component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

selectandaveragedata_4 = Ladybug_AverageData(
    annualHourlyData=[importepw_3.dry_bulb_temperature, importepw_2.dryBulbTemperature],
    analysisPeriod=importstat.extremeHotWeek)  # -> readMe, selHourlyData, averagedDaily, averagedMonthly, avrMonthlyPerHour, avrMonthlyMinPerHour, avrMonthlyMaxPerHour; plug-in component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
selectandaveragedata_5 = Ladybug_AverageData(annualHourlyData=[importepw_3.wind_speed, importepw_2.windSpeed], analysisPeriod=importstat.extremeHotWeek)  # -> readMe, selHourlyData, averagedDaily, averagedMonthly, avrMonthlyPerHour, avrMonthlyMinPerHour, avrMonthlyMaxPerHour; plug-in component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
strnum_6 = Ladybug_SeparateData(inputList=flatten(selectandaveragedata_5.selHourlyData))  # -> numbers, strings; plug-in component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
strnum_7 = Ladybug_SeparateData(inputList=flatten(selectandaveragedata_4.selHourlyData))  # -> numbers, strings; plug-in component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

selectandaveragedata_6 = Ladybug_AverageData(annualHourlyData=[importepw_3.relative_humidity, importepw_2.relativeHumidity], analysisPeriod=importstat.extremeHotWeek)  # -> readMe, selHourlyData, averagedDaily, averagedMonthly, avrMonthlyPerHour, avrMonthlyMinPerHour, avrMonthlyMaxPerHour; plug-in component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
strnum_8 = Ladybug_SeparateData(inputList=flatten(selectandaveragedata_6.selHourlyData))  # -> numbers, strings; plug-in component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

average_15 = Average(Input=strnum_3.numbers)
average_16 = Average(Input=strnum_4.numbers)
average_17 = Average(Input=strnum_2.numbers)
average_18 = Average(Input=strnum_7.numbers)
average_19 = Average(Input=strnum_8.numbers)
average_20 = Average(Input=strnum_6.numbers)
average_21 = Average(Input=strnum_5.numbers)
average_22 = Average(Input=flatten(strnum.numbers))
param_viewer = ParamViewer(strnum.numbers)
panel = Panel(average_21)
panel_2 = Panel(average_22)
utci = LBUTCIComfort(
    air_temp=average_15,
    mrt=average_21,
    rel_humid=average_16,
    wind_vel=average_17,
    utci_par=importstat_2.typicalWinterWeek,
    run=Toggle(True))  # -> out, utci, comfort, condition, category, comf_obj; plug-in component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
utci_2 = LBUTCIComfort(
    air_temp=average_18,
    mrt=average_22,
    rel_humid=average_19,
    wind_vel=average_20,
    utci_par=importstat.extremeHotWeek,
    run=Toggle(True))  # -> out, utci, comfort, condition, category, comf_obj; plug-in component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
panel_3 = Panel(utci.utci)
panel_4 = Panel(utci_2.utci)
number = Number(utci.utci)
bounds = Bounds(Numbers=number)
number_2 = Number(utci_2.utci)
bounds_2 = Bounds(Numbers=number_2)
deconstruct_domain = DeconstructDomain(Domain=bounds)  # -> Start, End
deconstruct_domain_2 = DeconstructDomain(Domain=bounds_2)  # -> Start, End
mesh_3 = Mesh(gentestpts.mesh)

legendpar = Ladybug_LegendParameters(
    lowBound=deconstruct_domain_2.Start,
    highBound=deconstruct_domain_2.End,
    numSegments="9",
    decimalPlaces="1",
    removeLessThan=Toggle(True))  # -> legendPar; plug-in component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
recolormesh = Ladybug_RecolorMesh(analysisResult=utci_2.utci, inputMesh=mesh_3, legendPar=legendpar, analysisTitle="UTCI", legendTitle="C")  # -> readMe, newMesh, newLegend, legendBasePt, meshColors, legendColors; plug-in component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

mesh_4 = Mesh(gentestpts.mesh)

legendpar_2 = Ladybug_LegendParameters(
    lowBound=deconstruct_domain.Start,
    highBound=deconstruct_domain.End,
    numSegments="9",
    decimalPlaces="1",
    removeLessThan=Toggle(True))  # -> legendPar; plug-in component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
recolormesh_2 = Ladybug_RecolorMesh(analysisResult=utci.utci, inputMesh=mesh_4, legendPar=legendpar_2, analysisTitle="UTCI", legendTitle="C")  # -> readMe, newMesh, newLegend, legendBasePt, meshColors, legendColors; plug-in component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

average_23 = Average(Input=flatten(utci_2.utci))
average_24 = Average(Input=flatten(utci.utci))
panel_5 = Panel(average_24)
# 冬季热舒适
panel_6 = Panel(recolormesh_2.newLegend)
# 夏季热舒适
panel_7 = Panel(average_23)
panel_8 = Panel(recolormesh.newLegend)
minimise_summerthermal_comfort = Number(average_23)
maximise_winter_thermal_comfort = Number(average_24)
maximise_total_radiation = Number(average_14)
one_over_x = OneOverX(Value=maximise_winter_thermal_comfort)
one_over_x_2 = OneOverX(Value=maximise_total_radiation)
wlc_minimise_winter_thermal_comfort = Number(one_over_x)
wlc_minimise_total_radiation = Number(one_over_x_2)
wlc_minimise_summerthermal_comfort = Number(minimise_summerthermal_comfort)
wallacei_x = WallaceiX(
    Genes=[gene_pool, gene_pool_2],
    Objectives=[wlc_minimise_summerthermal_comfort, wlc_minimise_total_radiation, wlc_minimise_winter_thermal_comfort],
    Phenotype=rotate.Geometry,
    allFitness="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",
    allFrontIdx="3|9;4|8;6|0;6|13;6|14;6|15;7|2;7|3;7|4;7|10;8|4;8|11;9|2;10|5;10|15;11|4;11|6;11|11;11|15;12|3;12|15;13|0;13|1;13|2;14|1;14|2;14|4;14|14;14|15;15|8;15|9;15|14;16|1;16|2;16|4;16|9;16|11;17|0;17|2;17|3;17|11;17|12;18|8;18|10;18|12;18|14;18|15;19|0;19|1;19|7;19|14",
    allGenomes="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",
    curFrontIdx="19|0;19|1;19|2;19|3;19|4;19|5;19|6;19|7;19|8;19|9;19|10;19|11;19|12;19|13;19|14;19|15",
    curFrontIdxSave="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",
    popGen="16,20",
    total="1727063",
    wlcDone=True)  # -> WallaceiGenomes, FitnessValues, Data, Phenotypes
decode_phenotype = DecodePhenotype()  # -> GeometriesList, MeshesList, NumbersList, TextList
distribute_to_grid = DistributeToGrid(FitnessValues=wallacei_x.FitnessValues, WallaceiPhenotypes=wallacei_x.Phenotypes, OutputOptions=0)  # -> DistributedFitnessValues, DistributedData, DistributedGeometries, DistributedMeshes, DistributedNumbers, GridLocations
decode_genome = DecodeGenome(WallaceiGenome=wallacei_x.WallaceiGenomes)  # -> simplify(GeneList)
panel_9 = Panel(wallacei_x.FitnessValues)
trim_tree = TrimTree(Tree=distribute_to_grid.DistributedGeometries, Depth=1)
list_length = ListLength(List=distribute_to_grid.DistributedGeometries)
list_length_2 = ListLength(List=wallacei_x.FitnessValues)
trim_tree_2 = TrimTree(Tree=list_length, Depth=1)
tree_statistics = TreeStatistics(Tree=trim_tree_2)  # -> Paths, Length, Count
tree_branch = TreeBranch(Tree=decode_genome, Path=tree_statistics.Paths, MaintainPaths=True)
panel_10 = Panel(tree_branch)
panel_11 = Panel(list_length)
panel_13 = Panel(decode_genome)
key_value_search = KeyValueSearch()
panel_14 = Panel(distribute_to_grid.DistributedFitnessValues)
file_path = FilePath("C:\Users\Administrator\Desktop\帕雷托最优.xlsx")
excelwrite = ExcelWrite(Start=Toggle(False), FilePath=file_path, Title="帕雷托最优", Cell="A1", Data=tree_branch)
